vi "DC Voltage.gvi"   [LabVIEW NXG 5.1.0]
panel controls:
  "Manual Range": f64 = "1 V"(1)
  "Auto Range": bool = TRUE
  "Auto Zero": bool = TRUE
  "DCV Ratio": bool
  "Auto Impedance": bool
  "Aperture NPLC": f64 = "10 PLC"(10)
  "Aperture Time": f64 = 0.1
  "Aperture": bool = TRUE
  "DIG Option On/Off": bool
  "stop": bool
panel indicators:
  "concatenated string": string
diagram:
  while {
    Property Node(instance in=reference to "Manual Range", "Disabled"=$"Auto Range")
    Quotient And Remainder(x=$"Aperture Time", y=2e-06) -> (floor(x/y)=w1, x-y*floor(x/y)=w2)
    Multiply(w2, 1000000) -> w3
    Round To Nearest(number=w3) -> w4
    To Signed 32 Bit Integer(number=w4) -> w5
    case (w5) {
      frame 0, Default {
        Multiply(2e-06, w1) -> w6
      }
      frame 1 {
        Multiply(2e-06, w1) -> w6
      }
      frame 2 {
        Add(1, w1) -> w7
        Multiply(2e-06, w7) -> w6
      }
    }
    $"Aperture Time" <- w6
    case ($"Auto Range") {
      frame False, Default {
        Format Into String(formatString="%.0pV", initString="Range: ", $"Manual Range") -> w8
      }
      frame True {
        w8 = "Range: Auto"
      }
    }
    case ($Aperture) {
      frame False, Default {
        Format Into String(formatString="%_6ps", initString="Aperture Time: ", w6) -> w9
      }
      frame True {
        Format Into String(formatString="%#gPLC", initString="Aperture NPLC: ", $"Aperture NPLC") -> w9
      }
    }
    case ($"Auto Zero") {
      frame False, Default {
        w10 = "Auto Zero: Off"
      }
      frame True {
        w10 = "Auto Zero: On"
      }
    }
    case ($"Auto Impedance") {
      frame False, Default {
        w11 = "Input Z: 10MΩ"
      }
      frame True {
        w11 = "Input Z: Auto"
      }
    }
    case ($"DCV Ratio") {
      frame False, Default {
        w12 = "DCV Ratio: Off"
      }
      frame True {
        $"Auto Zero" <- TRUE
        w12 = "DCV Ratio: On"
      }
    }
    Concatenate Strings("Your settings:", "\r\n", w8, "\r\n", w9, "\r\n", w10, "\r\n", w11, "\r\n", w12) -> w13
    $"concatenated string" <- w13
    case ($"DIG Option On/Off") {
      frame False, Default {
        w14 = 0.0002
      }
      frame True {
        w14 = 2e-05
      }
    }
    Property Node(instance in=reference to "Aperture Time", "Minimum"=w14)
    case ($"DIG Option On/Off") {
      frame False, Default {
        w15 = [0, 1, 2]
      }
      frame True {
        w15 = i32[] []
      }
    }
    Property Node(instance in=reference to "Aperture NPLC", "DisabledIndexes"=w15)
    Property Node(instance in=reference to "Aperture Time", "Disabled"=$Aperture)
    Not(x=$Aperture) -> w16
    Property Node(instance in=reference to "Aperture NPLC", "Disabled"=w16)
    Not(x=$"DCV Ratio") -> w17
    Property Node(instance in=reference to unnamed text, "Visible"=w17)
    Property Node(instance in=reference to "Auto Zero", "Disabled"=$"DCV Ratio")
    Property Node(instance in=reference to unnamed text, "Visible"=$"DCV Ratio")
    stop if $stop
  }
