vi "DZIALAALEDASIELEPIEJ.gvi"   [LabVIEW NXG 5.1.0]
panel controls:
  "1c": bool
  "2c": bool
  "3c": bool
  "4c": bool
  "stop": bool
panel indicators:
  "1c_2": bool
  "2c_2": bool
  "3c_2": bool
  "4c_2": bool
diagram:
  Property Node(instance in=reference to "4c_2", "Visible"=FALSE, "Disabled"=FALSE)
  Property Node(instance in=reference to "3c", "Visible"=TRUE, "Disabled"=FALSE)
  Property Node(instance in=reference to "4c", "Visible"=TRUE, "Disabled"=FALSE)
  Property Node(instance in=reference to "3c_2", "Visible"=FALSE)
  Property Node(instance in=reference to "2c", "Visible"=TRUE, "Disabled"=FALSE)
  $"2c" <- FALSE
  $"1c" <- FALSE
  $"3c" <- FALSE
  $"4c" <- FALSE
  Property Node(instance in=reference to "1c_2", "Visible"=FALSE)
  Property Node(instance in=reference to "2c_2", "Visible"=FALSE)
  Property Node(instance in=reference to "1c", "Visible"=TRUE, "Disabled"=FALSE)
  while {
    $"4c_2" <- $"4c"
    $"2c_2" <- $"2c"
    $"1c_2" <- $"1c"
    $"3c_2" <- $"3c"
    event {
      on "1c" Value changed {
        Event Data() -> ("Old Value"=w1, "New Value"=w2)
        Property Node(instance in=reference to "4c_2", "Visible"=w1)
        Property Node(instance in=reference to "3c_2", "Visible"=w1)
        Property Node(instance in=reference to "2c_2", "Visible"=w1)
        Property Node(instance in=reference to "1c", "Visible"=w1)
        Property Node(instance in=reference to "1c_2", "Visible"=w2)
        Property Node(instance in=reference to "4c", "Visible"=w2, "Value"=FALSE)
        Property Node(instance in=reference to "3c", "Visible"=w2, "Value"=FALSE)
        Property Node(instance in=reference to "2c", "Visible"=w2, "Value"=FALSE)
      }
      on "2c" Value changed {
        Event Data() -> ("Old Value"=w3, "New Value"=w4)
        Property Node(instance in=reference to "1c_2", "Visible"=w3)
        Property Node(instance in=reference to "2c", "Visible"=w3)
        Property Node(instance in=reference to "3c_2", "Visible"=w3)
        Property Node(instance in=reference to "4c_2", "Visible"=w3)
        Property Node(instance in=reference to "2c_2", "Visible"=w4)
        Property Node(instance in=reference to "4c", "Visible"=w4, "Value"=FALSE)
        Property Node(instance in=reference to "3c", "Visible"=w4, "Value"=FALSE)
        Property Node(instance in=reference to "1c", "Visible"=w4, "Value"=FALSE)
      }
      on "3c" Value changed {
        Event Data() -> ("Old Value"=w5, "New Value"=w6)
        Property Node(instance in=reference to "1c_2", "Visible"=w5)
        Property Node(instance in=reference to "2c_2", "Visible"=w5)
        Property Node(instance in=reference to "4c_2", "Visible"=w5)
        Property Node(instance in=reference to "3c", "Visible"=w5)
        Property Node(instance in=reference to "3c_2", "Visible"=w6)
        Property Node(instance in=reference to "4c", "Visible"=w6, "Value"=FALSE)
        Property Node(instance in=reference to "2c", "Visible"=w6, "Value"=FALSE)
        Property Node(instance in=reference to "1c", "Visible"=w6, "Value"=FALSE)
      }
      on "4c" Value changed {
        Event Data() -> ("Old Value"=w7, "New Value"=w8)
        Property Node(instance in=reference to "4c", "Visible"=w7)
        Property Node(instance in=reference to "1c_2", "Visible"=w7)
        Property Node(instance in=reference to "2c_2", "Visible"=w7)
        Property Node(instance in=reference to "3c_2", "Visible"=w7)
        Property Node(instance in=reference to "4c_2", "Visible"=w8)
        Property Node(instance in=reference to "3c", "Visible"=w8, "Value"=FALSE)
        Property Node(instance in=reference to "2c", "Visible"=w8, "Value"=FALSE)
        Property Node(instance in=reference to "1c", "Visible"=w8, "Value"=FALSE)
      }
    }
    stop if $stop
  }
