vi "MAIN.gvi"   [LabVIEW NXG 5.1.0]
panel controls:
  "stop": bool
  "measurement function": i32 = "Voltage DC"(10)
panel indicators:
  "error out_2": error
  "POMIAR": f64
uses:
  Agilent 3446X Series::Initialize.gvi
  Agilent 3446X Series::Configure Measurement.gvi
  Agilent 3446X Series::Read (Single Point).gvi
  Agilent 3446X Series::Close.gvi
diagram:
  call "Initialize.gvi"(VISA resource name="TCPIP0::A-34461A-0000-2.local::inst0::INSTR") -> (VISA resource name out=w1, error out=w2)
  while {
    call "Configure Measurement.gvi"(VISA resource name=w1, error in=w2, measurement function=$"measurement function") -> (VISA resource name out=w3, error out=w4)
    case (TRUE) {
      frame False, Default {
        w5 = w3
        w6 = w4
      }
      frame True {
        call "Read (Single Point).gvi"(VISA resource name=w3, error in=w4) -> (VISA resource name out=w5, error out=w6, measurement=w7)
        $POMIAR <- w7
      }
    }
    stop if $stop
  }
  call "Close.gvi"(VISA resource name=w5, error in=w6) -> (error out=w8)
  $"error out_2" <- w8
