vi "MAINTEST.gvi"   [LabVIEW NXG 5.1.0]
panel controls:
  "Manual Range": f64 = "1 V"(1)
  "Auto Range": bool = TRUE
  "Auto Zero": bool = TRUE
  "DCV Ratio": bool
  "Auto Impedance": bool
  "Aperture NPLC": f64 = "10 PLC"(10)
  "Aperture Time": f64 = 0.1
  "DIG Option On/Off": bool
  "stop": bool
  "Aperture": bool = TRUE
  "Image Button": bool
  "Image Button_2": bool
  "Image Button_3": bool
  "Image Button_4": bool
  "stop_2": bool
panel indicators:
  "concatenated string": string
  "Image Button_5": bool
  "Image Button_6": bool
  "Image Button_7": bool
  "Image Button_8": bool
diagram:
  $"Image Button_2" <- FALSE
  $"Image Button_3" <- FALSE
  $"Image Button" <- FALSE
  $"Image Button_4" <- FALSE
  while {
    Property Node(instance in=reference to "Panel Container")
    Build Array(reference to "Image Button", reference to "Image Button_2", reference to "Image Button_3", reference to "Image Button_4") -> w1
    s1 = w1  # shift register
    while {
      event (after s1) {
        on "Image Button" Value changed {
          w2 = default
        }
      }
      next s1 = w2
      stop if $stop_2
    }
    Open VI Reference(vi name="MAIN.gvi") -> (vi reference=w3)
    Insert VI Panel(reference in=reference to "Panel Container", vi reference=w3)
    $"Image Button_5" <- $"Image Button"
    $"Image Button_6" <- $"Image Button_2"
    $"Image Button_7" <- $"Image Button_3"
    Build Cluster(w1) -> w4
    Property Node(instance in=w4)
    Property Node(instance in=reference to "Manual Range", "Disabled"=$"Auto Range")
    $"Image Button_8" <- $"Image Button_4"
    Quotient And Remainder(x=$"Aperture Time", y=2e-06) -> (floor(x/y)=w5, x-y*floor(x/y)=w6)
    Multiply(w6, 1000000) -> w7
    Round To Nearest(number=w7) -> w8
    To Signed 32 Bit Integer(number=w8) -> w9
    case (w9) {
      frame 0, Default {
        Multiply(2e-06, w5) -> w10
      }
      frame 1 {
        Multiply(2e-06, w5) -> w10
      }
      frame 2 {
        Add(1, w5) -> w11
        Multiply(2e-06, w11) -> w10
      }
    }
    $"Aperture Time" <- w10
    case ($Aperture) {
      frame False, Default {
        Format Into String(formatString="%_6ps", initString="Aperture Time: ", w10) -> w12
      }
      frame True {
        Format Into String(formatString="%#gPLC", initString="Aperture NPLC: ", $"Aperture NPLC") -> w12
      }
    }
    case ($"DCV Ratio") {
      frame False, Default {
        w13 = "DCV Ratio: Off"
      }
      frame True {
        $"Auto Zero" <- TRUE
        w13 = "DCV Ratio: On"
      }
    }
    case ($"Auto Range") {
      frame False, Default {
        Format Into String(formatString="%.0pV", initString="Range: ", $"Manual Range") -> w14
      }
      frame True {
        w14 = "Range: Auto"
      }
    }
    case ($"Auto Zero") {
      frame False, Default {
        w15 = "Auto Zero: Off"
      }
      frame True {
        w15 = "Auto Zero: On"
      }
    }
    case ($"Auto Impedance") {
      frame False, Default {
        w16 = "Input Z: 10MΩ"
      }
      frame True {
        w16 = "Input Z: Auto"
      }
    }
    Concatenate Strings("Your settings:", "\r\n", w14, "\r\n", w12, "\r\n", w15, "\r\n", w16, "\r\n", w13) -> w17
    $"concatenated string" <- w17
    case ($"DIG Option On/Off") {
      frame False, Default {
        w18 = [0, 1, 2]
      }
      frame True {
        w18 = i32[] []
      }
    }
    Property Node(instance in=reference to "Aperture NPLC", "DisabledIndexes"=w18)
    Not(x=$Aperture) -> w19
    Property Node(instance in=reference to "Aperture NPLC", "Disabled"=w19)
    case ($"DIG Option On/Off") {
      frame False, Default {
        w20 = 0.0002
      }
      frame True {
        w20 = 2e-05
      }
    }
    Property Node(instance in=reference to "Aperture Time", "Minimum"=w20)
    Property Node(instance in=reference to "Aperture Time", "Disabled"=$Aperture)
    Not(x=$"DCV Ratio") -> w21
    Property Node(instance in=reference to unnamed text, "Visible"=w21)
    Property Node(instance in=reference to unnamed text, "Visible"=$"DCV Ratio")
    Property Node(instance in=reference to "Auto Zero", "Disabled"=$"DCV Ratio")
    stop if $stop
  }
