vi "UCZELNIATEST1.gvi"   [LabVIEW NXG 5.1.0]
panel controls:
  "VoltageDC_control": bool
  "VoltageAC_control": bool
  "CurrentDC_control": bool
  "CurrentAC_control": bool
  "stop": bool
  "Auto Range": bool = TRUE
  "Auto Zero": bool = TRUE
  "Aperture NPLC": f64 = "10 PLC"(10)
  "Aperture Time": f64 = 0.1
  "Aperture": bool = TRUE
  "Manual Range": f64 = "1 V"(1)
panel indicators:
  "VoltageDC_indicator": bool
  "VoltageAC_indicator": bool
  "CurrentDC_indicator": bool
  "CurrentAC_indicator": bool
  "DCV Ratio": bool
  "Auto Impedance": bool
  "DIG Option On/Off": bool
  "concatenated string_2": string
uses:
  Agilent 3446X Series::Initialize.gvi
diagram:
  Property Node(instance in=reference to "CurrentAC_indicator", "Visible"=FALSE, "Disabled"=FALSE)
  $"Auto Range" <- TRUE
  $"Auto Zero" <- TRUE
  Property Node(instance in=reference to "CurrentDC_control", "Visible"=TRUE, "Disabled"=FALSE)
  $"DIG Option On/Off" <- TRUE
  $"DCV Ratio" <- FALSE
  Property Node(instance in=reference to "CurrentAC_control", "Visible"=TRUE, "Disabled"=FALSE)
  Property Node(instance in=reference to "CurrentDC_indicator", "Visible"=FALSE)
  Property Node(instance in=reference to "VoltageAC_control", "Visible"=TRUE, "Disabled"=FALSE)
  $VoltageAC_control <- FALSE
  $VoltageDC_control <- FALSE
  $CurrentDC_control <- FALSE
  $CurrentAC_control <- FALSE
  Property Node(instance in=reference to "Auto Range", "Visible"=FALSE)
  Property Node(instance in=reference to "concatenated string_2", "Visible"=FALSE)
  Property Node(instance in=reference to "Auto Zero", "Visible"=FALSE)
  Property Node(instance in=reference to unnamed text, "Visible"=TRUE)
  Property Node(instance in=reference to "VoltageDC_indicator", "Visible"=FALSE)
  Property Node(instance in=reference to "Aperture", "Visible"=FALSE)
  Property Node(instance in=reference to unnamed text, "Visible"=FALSE)
  Property Node(instance in=reference to unnamed text, "Visible"=FALSE)
  Property Node(instance in=reference to "Manual Range", "Visible"=FALSE)
  Property Node(instance in=reference to unnamed text, "Visible"=FALSE)
  Property Node(instance in=reference to "Aperture NPLC", "Visible"=FALSE)
  Property Node(instance in=reference to "VoltageAC_indicator", "Visible"=FALSE)
  Property Node(instance in=reference to "DCV Ratio", "Visible"=FALSE)
  Property Node(instance in=reference to "VoltageDC_control", "Visible"=TRUE, "Disabled"=FALSE)
  Property Node(instance in=reference to unnamed text, "Visible"=FALSE)
  Property Node(instance in=reference to "DIG Option On/Off", "Visible"=FALSE)
  Property Node(instance in=reference to "Aperture Time", "Visible"=FALSE)
  $Aperture <- TRUE
  Property Node(instance in=reference to "Auto Impedance", "Visible"=FALSE)
  $"DCV Ratio" <- FALSE
  $"Auto Impedance" <- FALSE
  while {
    $CurrentAC_indicator <- $CurrentAC_control
    event {
      on "VoltageDC_control" Value changed {
        Property Node(instance in=reference to unnamed text, "Visible"=TRUE)
        Event Data() -> ("Old Value"=w1, "New Value"=w2)
        Property Node(instance in=reference to "CurrentDC_control", "Visible"=w2, "Value"=FALSE)
        Property Node(instance in=reference to "VoltageDC_control", "Visible"=w1)
        Property Node(instance in=reference to "CurrentAC_control", "Visible"=w2, "Value"=FALSE)
        Property Node(instance in=reference to "VoltageDC_indicator", "Visible"=w2)
        Property Node(instance in=reference to "CurrentDC_indicator", "Visible"=w1)
        Property Node(instance in=reference to "VoltageAC_control", "Visible"=w2, "Value"=FALSE)
        Property Node(instance in=reference to "VoltageAC_indicator", "Visible"=w1)
        Property Node(instance in=reference to "CurrentAC_indicator", "Visible"=w1)
        Property Node(instance in=reference to "Manual Range", "Visible"=TRUE)
        Property Node(instance in=reference to "Aperture NPLC", "Visible"=TRUE)
        Property Node(instance in=reference to "Aperture Time", "Visible"=TRUE)
        Property Node(instance in=reference to "concatenated string_2", "Visible"=TRUE)
        Property Node(instance in=reference to "Auto Range", "Visible"=TRUE)
        Property Node(instance in=reference to "DCV Ratio", "Visible"=TRUE)
        Property Node(instance in=reference to "Auto Impedance", "Visible"=TRUE)
        Property Node(instance in=reference to "Auto Zero", "Visible"=TRUE)
        Property Node(instance in=reference to "DIG Option On/Off", "Visible"=TRUE)
        Property Node(instance in=reference to unnamed text, "Visible"=FALSE)
        Property Node(instance in=reference to unnamed text, "Visible"=FALSE)
        Property Node(instance in=reference to unnamed text, "Visible"=FALSE)
        Property Node(instance in=reference to "Aperture", "Visible"=TRUE)
      }
      on "VoltageAC_control" Value changed {
        Property Node(instance in=reference to "Aperture", "Visible"=FALSE)
        Event Data() -> ("Old Value"=w3, "New Value"=w4)
        Property Node(instance in=reference to "VoltageDC_control", "Visible"=w4, "Value"=FALSE)
        Property Node(instance in=reference to unnamed text, "Visible"=w4)
        Property Node(instance in=reference to "VoltageAC_control", "Visible"=w3)
        Property Node(instance in=reference to "CurrentAC_control", "Visible"=w4, "Value"=FALSE)
        Property Node(instance in=reference to "CurrentDC_indicator", "Visible"=w3)
        Property Node(instance in=reference to "CurrentDC_control", "Visible"=w4, "Value"=FALSE)
        Property Node(instance in=reference to "CurrentAC_indicator", "Visible"=w3)
        Property Node(instance in=reference to "VoltageDC_indicator", "Visible"=w3)
        Property Node(instance in=reference to "VoltageAC_indicator", "Visible"=w4)
        Property Node(instance in=reference to "DCV Ratio", "Visible"=FALSE)
        Property Node(instance in=reference to "Aperture NPLC", "Visible"=FALSE)
        Property Node(instance in=reference to "Aperture Time", "Visible"=FALSE)
        Property Node(instance in=reference to "concatenated string_2", "Visible"=FALSE)
        Property Node(instance in=reference to "Auto Range", "Visible"=FALSE)
        Property Node(instance in=reference to unnamed text, "Visible"=FALSE)
        Property Node(instance in=reference to "Auto Impedance", "Visible"=FALSE)
        Property Node(instance in=reference to "Auto Zero", "Visible"=FALSE)
        Property Node(instance in=reference to "DIG Option On/Off", "Visible"=FALSE)
        Property Node(instance in=reference to unnamed text, "Visible"=FALSE)
        Property Node(instance in=reference to unnamed text, "Visible"=FALSE)
        Property Node(instance in=reference to "Manual Range", "Visible"=FALSE)
      }
      on "CurrentDC_control" Value changed {
        Event Data() -> ("Old Value"=w5, "New Value"=w6)
        Property Node(instance in=reference to "VoltageAC_control", "Visible"=w6, "Value"=FALSE)
        Property Node(instance in=reference to "VoltageAC_indicator", "Visible"=w5)
        Property Node(instance in=reference to "VoltageDC_indicator", "Visible"=w5)
        Property Node(instance in=reference to "VoltageDC_control", "Visible"=w6, "Value"=FALSE)
        Property Node(instance in=reference to "CurrentAC_control", "Visible"=w6, "Value"=FALSE)
        Property Node(instance in=reference to "CurrentDC_indicator", "Visible"=w6)
        Property Node(instance in=reference to "CurrentDC_control", "Visible"=w5)
        Property Node(instance in=reference to "CurrentAC_indicator", "Visible"=w5)
      }
      on "CurrentAC_control" Value changed {
        Event Data() -> ("Old Value"=w7, "New Value"=w8)
        Property Node(instance in=reference to "CurrentDC_indicator", "Visible"=w7)
        Property Node(instance in=reference to "VoltageDC_indicator", "Visible"=w7)
        Property Node(instance in=reference to "VoltageDC_control", "Visible"=w8, "Value"=FALSE)
        Property Node(instance in=reference to "CurrentDC_control", "Visible"=w8, "Value"=FALSE)
        Property Node(instance in=reference to "CurrentAC_indicator", "Visible"=w8)
        Property Node(instance in=reference to "VoltageAC_control", "Visible"=w8, "Value"=FALSE)
        Property Node(instance in=reference to "VoltageAC_indicator", "Visible"=w7)
        Property Node(instance in=reference to "CurrentAC_control", "Visible"=w7)
      }
      on "Aperture" Value changed; "Aperture NPLC" Value changed; "Aperture Time" Value changed; "Auto Impedance" Value changed; "Auto Range" Value changed; "Auto Zero" Value changed; "DCV Ratio" Value changed; "DIG Option On/Off" Value changed; "Manual Range" Value changed {
        Property Node(instance in=reference to "DIG Option On/Off") -> ("Value"=w9)
        case (w9) {
          frame False, Default {
            w10 = 0.0002
          }
          frame True {
            w10 = 2e-05
          }
        }
        Property Node(instance in=reference to "Aperture") -> ("Value"=w11)
        Property Node(instance in=reference to "Aperture Time", "Disabled"=w11, "Minimum"=w10) -> ("Value"=w12)
        Quotient And Remainder(x=w12, y=2e-06) -> (floor(x/y)=w13, x-y*floor(x/y)=w14)
        Multiply(w14, 1000000) -> w15
        Round To Nearest(number=w15) -> w16
        To Signed 32 Bit Integer(number=w16) -> w17
        case (w17) {
          frame 0, Default {
            Multiply(2e-06, w13) -> w18
          }
          frame 1 {
            Multiply(2e-06, w13) -> w18
          }
          frame 2 {
            Add(1, w13) -> w19
            Multiply(2e-06, w19) -> w18
          }
        }
        $"Aperture Time" <- w18
        case (w9) {
          frame False, Default {
            w20 = [0, 1, 2]
          }
          frame True {
            w20 = i32[] []
          }
        }
        Not(x=w11) -> w21
        Property Node(instance in=reference to "Aperture NPLC", "Disabled"=w21, "DisabledIndexes"=w20) -> ("Value"=w22)
        case (w11) {
          frame False, Default {
            Format Into String(formatString="%_6ps", initString="Aperture Time: ", w18) -> w23
          }
          frame True {
            Format Into String(formatString="%#gPLC", initString="Aperture NPLC: ", w22) -> w23
          }
        }
        Property Node(instance in=reference to "DCV Ratio") -> ("Value"=w24)
        case (w24) {
          frame False, Default {
            w25 = "DCV Ratio: Off"
          }
          frame True {
            $"Auto Zero" <- TRUE
            w25 = "DCV Ratio: On"
          }
        }
        Property Node(instance in=reference to "Auto Range") -> ("Value"=w26)
        Property Node(instance in=reference to "Manual Range", "Disabled"=w26) -> ("Value"=w27)
        case (w26) {
          frame False, Default {
            Format Into String(formatString="%.0pV", initString="Range: ", w27) -> w28
          }
          frame True {
            w28 = "Range: Auto"
          }
        }
        Property Node(instance in=reference to "Auto Impedance") -> ("Value"=w29)
        case (w29) {
          frame False, Default {
            w30 = "Input Z: 10MΩ"
          }
          frame True {
            w30 = "Input Z: Auto"
          }
        }
        Property Node(instance in=reference to "Auto Zero", "Disabled"=w24) -> ("Value"=w31)
        case (w31) {
          frame False, Default {
            w32 = "Auto Zero: Off"
          }
          frame True {
            w32 = "Auto Zero: On"
          }
        }
        Concatenate Strings("Your settings:", "\r\n", w28, "\r\n", w23, "\r\n", w32, "\r\n", w30, "\r\n", w25) -> w33
        $"concatenated string_2" <- w33
        Not(x=w24) -> w34
        Property Node(instance in=reference to unnamed text, "Visible"=w34)
        Property Node(instance in=reference to unnamed text, "Visible"=w24)
      }
    }
    $VoltageAC_indicator <- $VoltageAC_control
    $VoltageDC_indicator <- $VoltageDC_control
    $CurrentDC_indicator <- $CurrentDC_control
    stop if $stop
  }
  call "Initialize.gvi"()
